# Grasshopper definition Spiraltower.gh (Grasshopper 1.0.7)

pt = ConstructPoint(XCoordinate=Slider(0, range=0..100), YCoordinate=Slider(0, range=0..100), ZCoordinate=Slider(0, range=0..100))
number_of_arms = Slider(8, range=0..10)
cir = Circle(Plane=pt, Radius=Slider(21, range=0..100))
# Rotation inputs
rh_in_rotation = Slider(20, range=7..20)
rh_in_profile = Slider(2, range=2..10)
divide = DivideCurve(Curve=cir, Count=number_of_arms, Kinks=False)  # -> Points, Tangents, Parameters
pline = PolyLine(Vertices=divide.Points, Closed=True)
series = Series(Start=0, Step=rh_in_profile, Count=rh_in_rotation)
data = Data(rh_in_rotation)
Z = UnitZ(Factor=series)
move = Move(Geometry=pline, Motion=Z)  # -> Geometry, Transform
series_2 = Series(Start=0, Step=Slider(16, range=0..100), Count=data)
floor_bottom = Slider(1, range=0..100)
floor_top = Slider(7, range=0..100)
dom = ConstructDomain(DomainStart=Slider(0.1, range=0..1), DomainEnd=1)
range = Range(Domain=dom, Steps=expr("x-1", rh_in_rotation))
area = Area(Geometry=move.Geometry)  # -> Area, Centroid
rotate = Rotate(Geometry=move.Geometry, Angle=degrees(series_2), Plane=area.Centroid)  # -> Geometry, Transform
series_3 = Series(Start=floor_bottom, Step=1, Count=floor_top)
graph = GraphMapper(range, x0=0, x1=1, y0=0, y1=1, Ox=0.03141636029, Oy=0.2087804079, Px=0.8701328635, Py=1, container_name="Parabola")
rev = ReverseList(List=graph)
scale = Scale(Geometry=rotate.Geometry, Center=area.Centroid, Factor=rev)  # -> flatten(Geometry), Transform
item = ListItem(List=scale.Geometry, Index=series_3, Wrap=True)
srf = Surface(item)
explode = Explode(Curve=scale.Geometry, Recursive=True)  # -> Segments, Vertices
flip = FlipMatrix(Data=explode.Segments)
viewer = ParamViewer(flip)
tstat = TreeStatistics(Tree=flip)  # -> Paths, Length, Count
lng = ListLength(List=tstat.Paths)
series_4 = Series(Start=0, Step=1, Count=lng)
item_2 = ListItem(List=tstat.Paths, Index=series_4, Wrap=True)
dispatch = Dispatch(List=item_2, DispatchPattern=[True, False])  # -> ListA, ListB
branch = TreeBranch(Tree=[explode.Segments, flip], Path=dispatch.ListA, MaintainPaths=True)
branch_2 = TreeBranch(Tree=[explode.Segments, flip], Path=dispatch.ListB, MaintainPaths=True)
data_2 = Data(number_of_arms)
series_5 = Series(Start="0", Step=1, Count=data_2)
data_3 = Data(number_of_arms)
series_6 = Series(Start="0", Step=1, Count=data_3)

cull_i = CullIndex(List=branch_2, Indices=series_6, Wrap=True)
cull_i_2 = CullIndex(List=branch, Indices=series_5, Wrap=True)

loft = Loft(Curves=cull_i, Options={Adjust=False, Closed=False, LoftEnds=0, LoftSimp=0, LoftType=0, Rebuild=10, Refit=0.01})
debrep = DeconstructBrep(Brep=loft)  # -> Faces, Edges, Vertices
join = BrepJoin(Breps=[loft, srf])  # -> flatten(Breps), Closed
mesh = MeshBrep(
    Brep=join.Breps,
    Settings={GridMaxCount=0, GridMinCount=16, JaggedSeams=False, MaxEdgeLength=0, MinEdgeLength=0.0001, MinTolerance=0, Refine=True, RefineAngle=0, RelativeTolerance=0.65, SimplePlanes=True, Tolerance=0})
rh_out_mesh = Mesh(mesh)
