# Grasshopper definition Urban_Jungle.gh (Grasshopper 1.0.7)

xy = XYPlane(Origin=Point(0, 0, 0))
neg = Negative(Value=Slider(1, range=0..10))
Z = UnitZ(Factor=neg)
number_slider = Slider(3, range=0..100)
rh_in_y_units = Slider(8, range=0..100)
rh_in_x_units = Slider(5, range=-11..30)
rectangle = Rectangle(Plane=xy, XSize=rh_in_x_units, YSize=rh_in_y_units, Radius=0)  # -> Rectangle, Length
area = Area(Geometry=rectangle.Rectangle)  # -> Area, Centroid
scale = Scale(Geometry=rectangle.Rectangle, Center=area.Centroid, Factor=Slider(1.8, range=0..10))  # -> Geometry, Transform
extr = Extrude(Base=scale.Geometry, Direction=Z)
cap = CapHoles(Brep=extr)
mesh = Mesh(cap)
mcol = MeshColours(Mesh=mesh, Colours=ColourSwatch(SwatchColor=RGB(153, 103, 103)))
series = Series(Start=0, Step=Slider(1, range=0..10), Count=rh_in_x_units)

# ---- group: RH_OUT:Mesh3
mesh_2 = Mesh(mcol)

# ----
series_2 = Series(Start=0, Step=1, Count=rh_in_y_units)
series_3 = Series(Start=0, Step=1, Count=number_slider)
cross_reference = CrossReference(ListListA=series, ListListB=series_2, ListA=series_3, CrossMode=1)  # -> ListListA, ListListB, ListA
construct_point = ConstructPoint(XCoordinate=cross_reference.ListListA, YCoordinate=cross_reference.ListListB, ZCoordinate=cross_reference.ListA)  # -> simplify(Point)
rh_in_courtyard = Slider(0.8, range=0.1..1.1)
number_slider_2 = Slider(0.5, range=0..1)
bbox = BoundingBox(Content=construct_point, Plane=PlaneXY(0, 0, 0), UnionBox=True)  # -> Box, Box_2
debrep = DeconstructBrep(Brep=bbox.Box)  # -> Faces, Edges, Vertices
item = ListItem(List=debrep.Faces, Index=Slider(4, range=0..10), Wrap=True)
debrep_2 = DeconstructBrep(Brep=item)  # -> Faces, Edges, Vertices
join = JoinCurves(Curves=debrep_2.Edges, Preserve=False)
area_2 = Area(Geometry=join)  # -> Area, Centroid
scale_2 = Scale(Geometry=join, Center=area_2.Centroid, Factor=rh_in_courtyard)  # -> Geometry, Transform
Z_2 = UnitZ(Factor=number_slider)
extr_2 = Extrude(Base=scale_2.Geometry, Direction=Z_2)
pop3d = Populate3D(Region=bbox.Box, Count=100, Seed=1)
cap_2 = CapHoles(Brep=extr_2)
mesh_3 = Mesh(cap_2)
pdecon = Deconstruct(Point=pop3d)  # -> XComponent, YComponent, ZComponent
larger = LargerThan(FirstNumber=pdecon.ZComponent, SecondNumber=Slider(0.14, range=0..3))  # -> LargerThan, OrEqualTo
rh_in_randomize = Slider(51, range=0..100)
cull = CullPattern(List=pop3d, CullPattern=larger.LargerThan)
lng = ListLength(List=cull)
rh_in_reduce_blocks = Slider(0, range=0..100)
dom = ConstructDomain(DomainStart=Slider(0, range=0..100), DomainEnd=Slider(1, range=0..1))
random = Random(Range=dom, Number=lng, Seed=rh_in_randomize)
multiplication = Multiplication(A=random, B=Slider(4, range=0..10))
sph = Sphere(Base=cull, Radius=multiplication)
mesh_4 = Mesh(sph)
rh_in_reduce_trees = Slider(0, range=0..10)
dom_2 = ConstructDomain(DomainStart=Slider(0.18, range=0..1), DomainEnd=Slider(0.45, range=0..1))
number_slider_3 = Slider(0.1, range=0..1)
reduce = RandomReduce(List=cull, Reduction=rh_in_reduce_trees, Seed=1)
lng_2 = ListLength(List=reduce)
random_2 = Random(Range=dom_2, Number=lng_2, Seed=2)
sph_2 = Sphere(Base=reduce, Radius=random_2)
multiplication_2 = Multiplication(A=random_2, B=Slider(0.07, range=0..0.1))
volume = Volume(Geometry=sph_2)  # -> Volume, Centroid
mesh_5 = Mesh(sph_2)
mjoin = MeshJoin(Meshes=flatten([mesh_4, mesh_3, mesh_5]))
minc = MeshInclusion(Mesh=mjoin, Point=construct_point, Strict=False)
dispatch = Dispatch(List=construct_point, DispatchPattern=minc)  # -> ListA, ListB
point = Point(dispatch.ListB)
box = CenterBox(Base=point, X=number_slider_2, Y=number_slider_2, Z=number_slider_2)
brep = Brep(box)
reduce_2 = RandomReduce(List=brep, Reduction=rh_in_reduce_blocks, Seed=1)
mesh_6 = Mesh(reduce_2)
debrep_3 = DeconstructBrep(Brep=reduce_2)  # -> Faces, Edges, Vertices
item_2 = ListItem(List=debrep_3.Faces, Index=Slider(4, range=0..10), Wrap=True)
debrep_4 = DeconstructBrep(Brep=item_2)  # -> Faces, Edges, Vertices
project = Project(Geometry=debrep_4.Vertices, Plane=PlaneXY(0, 0, 0))  # -> simplify(Geometry), Transform
cir = Circle(Plane=debrep_4.Vertices, Radius=Slider(0.05, range=0..0.1))  # -> simplify(graft(Circle))
cir_2 = Circle(Plane=project.Geometry, Radius=Slider(0.05, range=0..0.1))  # -> simplify(graft(Circle))
loft = Loft(Curves=[cir, cir_2], Options={Adjust=False, Closed=False, LoftEnds=0, LoftSimp=0, LoftType=0, Rebuild=10, Refit=0.01})
mcol_2 = MeshColours(Mesh=mesh_5, Colours=ColourSwatch(SwatchColor=RGB(108, 199, 88)))
cir_3 = Circle(Plane=volume.Centroid, Radius=multiplication_2)  # -> graft(Circle)
cap_3 = CapHoles(Brep=loft)  # -> flatten(Brep)
project_2 = Project(Geometry=cir_3, Plane=PlaneXY(0, 0, 0))  # -> Geometry, Transform
loft_2 = Loft(
    Curves=[cir_3, project_2.Geometry],
    Options={Adjust=False, Closed=False, LoftEnds=0, LoftSimp=0, LoftType=0, Rebuild=10, Refit=0.01})
mesh_7 = Mesh(loft_2)
mesh_8 = Mesh(cap_3)
mcol_3 = MeshColours(Mesh=mesh_7, Colours=ColourSwatch(SwatchColor=RGB(148, 38, 38)))
mcol_4 = MeshColours(Mesh=mesh_6, Colours=ColourSwatch(SwatchColor=RGB(181, 58, 58)))
mcol_5 = MeshColours(Mesh=mesh_8, Colours=ColourSwatch(SwatchColor=RGB(112, 112, 112)))

# ---- group: RH_OUT:Mesh2
mesh_9 = Mesh(mcol_4)

# ---- group: RH_OUT:Mesh1
mesh_10 = Mesh(mcol_5)

# ----
mesh_11 = Mesh(flatten([mcol_2, mcol_3]))
mjoin_2 = MeshJoin(Meshes=mesh_11)

# ---- group: RH_OUT:Mesh
mesh_12 = Mesh(mjoin_2)
