# Grasshopper definition cellular_automata.gh (Grasshopper 1.0.7)
# plug-ins: Pufferfish, Anemone, Kangaroo2 Components

md_slider = MDSlider(
    SliderMode=0,
    slider_value=Point(0.5454602067, 0.3663776677, 0.5),
    x_domain=Domain(0, 1),
    y_domain=Domain(0, 1),
    z_domain=Domain(0, 1))
md_slider_2 = MDSlider(
    SliderMode=0,
    slider_value=Point(0.2839593015, 0.4066887832, 0.5),
    x_domain=Domain(0, 1),
    y_domain=Domain(0, 1),
    z_domain=Domain(0, 1))
md_slider_3 = MDSlider(
    SliderMode=0,
    slider_value=Point(0.4555493855, 0.2638787991, 0.5),
    x_domain=Domain(0, 1),
    y_domain=Domain(0, 1),
    z_domain=Domain(0, 1))
rh_in_grid_spacing = Slider(15, range=0..30)
rh_in_grid_size = Slider(10, range=0..10)
series = Series(Start=0, Step=rh_in_grid_size, Count=rh_in_grid_spacing)
multiplication = Multiplication(A=rh_in_grid_spacing, B=Slider(10, range=0..10))
pt = ConstructPoint(XCoordinate=graft(series), YCoordinate=series, ZCoordinate=0)  # -> simplify(Point)
data = Data(flatten(pt))
brec = BoundingRectangle(Geometry=data, Plane=PlaneXY(0, 0, 0), Axis=0, Slide=0, Union=True)  # -> Bounding, DimensionX, DimensionY
evalsrf = EvaluateSurface(Surface=reparameterize(brec.Bounding), Point=md_slider_2)  # -> Point, Normal, UDirection, VDirection, Frame
evalsrf_2 = EvaluateSurface(Surface=reparameterize(brec.Bounding), Point=md_slider)  # -> Point, Normal, UDirection, VDirection, Frame
evalsrf_3 = EvaluateSurface(Surface=reparameterize(brec.Bounding), Point=md_slider_3)  # -> Point, Normal, UDirection, VDirection, Frame
rectangle = Rectangle(Plane=evalsrf.Point, XSize=Slider(10, range=0..10), YSize=Slider(44, range=0..100), Radius=0)  # -> Rectangle, Length
rectangle_2 = Rectangle(Plane=evalsrf_2.Point, XSize=Slider(32, range=0..100), YSize=Slider(26, range=0..30), Radius=0)  # -> Rectangle, Length
rectangle_3 = Rectangle(Plane=evalsrf_3.Point, XSize=Slider(10, range=0..10), YSize=Slider(60, range=0..100), Radius=0)  # -> Rectangle, Length
crv = Curve(rectangle.Rectangle)
crv_2 = Curve(rectangle_3.Rectangle)
crv_3 = Curve(rectangle_2.Rectangle)
addition = Addition(A=multiplication, B=Slider(10, range=0..10))
rh_in_toggle_rules = BooleanToggle(True)
merge = Merge(Data1=crv_3, Data2=crv, Data3=crv_2)
merge_2 = Merge(Data1=crv_3, Data2=crv)
polygon = Polygon(Plane=pt, Radius=3, Segments=6, FilletRadius=0)  # -> Polygon, Length
rh_in_rule_filter = Slider(1, range=0..2)
X = UnitX(Factor=addition)
move = Move(Geometry=polygon.Polygon, Motion=X)  # -> Geometry, Transform
list = ValueList({"Single": 0, "Double": 1, "Triple": 2}, selected="Triple")
offset = OffsetCurve(Curve=polygon.Polygon, Distance=1, Plane=PlaneXY(0, 0, 0), Corners=1)
num = Number(rh_in_rule_filter)
filter = StreamFilter(Gate=num, Stream0=crv_2, Stream1=merge_2, Stream2=merge)
incurves = PointInCurves(Point=pt, Curves=filter)  # -> Relationship, Index, Point
data_2 = Data(simplify(graft(polygon.Polygon)))
data_3 = Data(simplify(graft(offset)))
division = Division(A=incurves.Relationship, B=2)
data_4 = Data(simplify(graft(filter)))
int = Integer(division)
merge_3 = Merge(Data1=data_2, Data2=data_3)
tag = TextTag3D(Location=pt, Text=int, Size=Slider(5, range=0..10), Justification=7)
offset_2 = OffsetCurve(Curve=filter, Distance=1, Plane=PlaneXY(0, 0, 0), Corners=1)
data_5 = Data(simplify(graft(offset_2)))
boundary = BoundarySurfaces(Edges=merge_3)
panel = Panel(merge_3)
merge_4 = Merge(Data1=data_4, Data2=data_5)
num_2 = Number(int)
Z = UnitZ(Factor=1)
pdecon = Deconstruct(Point=pt)  # -> XComponent, YComponent, ZComponent
boundary_2 = BoundarySurfaces(Edges=merge_4)
Z_2 = UnitZ(Factor=1)
extr = Extrude(Base=boundary_2, Direction=Z_2)
branch = TreeBranch(Tree=pdecon.YComponent, Path="0", MaintainPaths=True)
rh_in_step = Slider(0, range=0..50)
mesh = Mesh(extr)
move_2 = Move(Geometry=mesh, Motion=X)  # -> Geometry, Transform
mcol = MeshColours(Mesh=move_2.Geometry, Colours=ColourSwatch(SwatchColor=RGB(255, 255, 255)))
gate = StreamGate(Stream=[move.Geometry, mcol], Gate=rh_in_toggle_rules)  # -> Target0, Target1
mesh_2 = Mesh(gate.Target1)
fastloopstart = FastLoopStart(I=rh_in_step, Grid=pt, _0_or_1=num_2)  # -> port, Counter, Data, _0Or1
num_3 = Number(simplify(fastloopstart._0Or1))
tstat = TreeStatistics(Tree=num_3)  # -> Paths, Length, Count
shift = ShiftList(List=tstat.Paths, Shift=1, Wrap=True)
shift_2 = ShiftList(List=tstat.Paths, Shift="-1", Wrap=True)
branch_2 = TreeBranch(Tree=num_3, Path=shift, MaintainPaths=False)
branch_3 = TreeBranch(Tree=num_3, Path=shift_2, MaintainPaths=False)
num_4 = Number(graft(branch_3))
num_5 = Number(graft(branch_2))
shift_3 = ShiftList(List=num_3, Shift=1, Wrap=True)  # -> graft(List)
shift_4 = ShiftList(List=num_3, Shift="-1", Wrap=True)  # -> graft(List)
shift_5 = ShiftList(List=branch_2, Shift=1, Wrap=True)  # -> graft(List)
shift_6 = ShiftList(List=branch_2, Shift="-1", Wrap=True)  # -> graft(List)
shift_7 = ShiftList(List=branch_3, Shift="-1", Wrap=True)  # -> graft(List)
shift_8 = ShiftList(List=branch_3, Shift=1, Wrap=True)  # -> graft(List)
merge_5 = Merge(
    Data1=simplify(shift_3),
    Data2=simplify(shift_4),
    Data3=simplify(shift_5),
    Data4=simplify(num_5),
    Data5=simplify(shift_6),
    Data6=simplify(shift_8),
    Data7=simplify(num_4),
    Data8=simplify(shift_7))
num_6 = Number(num_3)
viewer = ParamViewer(merge_5)
ma = MassAddition(Input=merge_5)  # -> Result, PartialResults
trim = TrimTree(Tree=ma.Result, Depth=1)

# ---- group: Life
smaller = SmallerThan(FirstNumber=trim, SecondNumber=Slider(3, range=0..10))  # -> SmallerThan, OrEqualTo
larger = LargerThan(FirstNumber=trim, SecondNumber=Slider(3, range=0..10))  # -> LargerThan, OrEqualTo
and = GateAnd(A=larger.OrEqualTo, B=smaller.OrEqualTo)

# ---- group: Death
smaller_2 = SmallerThan(FirstNumber=trim, SecondNumber=Slider(2, range=0..10))  # -> SmallerThan, OrEqualTo
larger_2 = LargerThan(FirstNumber=trim, SecondNumber=Slider(3, range=0..10))  # -> LargerThan, OrEqualTo
or = GateOr(A=smaller_2.SmallerThan, B=larger_2.LargerThan)

# ----
cull = CullPattern(List=pt, CullPattern=or)  # disabled
lng = ListLength(List=num_6)
repeat = RepeatData(Data=Slider(0, range=0..100), Length=lng)
lng_2 = ListLength(List=num_6)
p_n_c = PickNChoose(Pattern=or, Stream0=num_6, Stream1=repeat)
repeat_2 = RepeatData(Data=Slider(1, range=0..100), Length=lng_2)
p_n_c_2 = PickNChoose(Pattern=and, Stream0=p_n_c, Stream1=repeat_2)
panel_2 = Panel(p_n_c_2)
gradient = Gradient(
    LowerLimit=0,
    UpperLimit=1,
    Parameter=pdecon.YComponent,
    stops=[0: RGB(115, 123, 153), 0: RGB(27, 30, 248), 0: RGB(192, 255, 192), 0: RGB(142, 4, 222), 0: RGB(41, 147, 36), 0: RGB(24, 165, 207), 0: RGB(154, 227, 4), 0: RGB(5, 12, 93), 0: RGB(142, 156, 202), 0: RGB(115, 79, 171)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])
swatch = ColourSwatch(SwatchColor=RGB(101, 201, 201))
fastloopend = FastLoopEnd(port=fastloopstart.port, Exit=False, Data=fastloopstart.Data, _0Or1=p_n_c_2, RecordData=False, TimeOutVal=0)  # -> D0, D1
mcol_2 = MeshColours(Mesh=mesh_2, Colours=gradient)
cull_2 = CullPattern(List=fastloopend.D0, CullPattern=fastloopend.D1)

# ---- group: RH_OUT:Mesh1
mesh_3 = Mesh(mcol_2)

# ----
polygon_2 = Polygon(Plane=cull_2, Radius=3, Segments=6, FilletRadius=0)  # -> flatten(Polygon), Length
data_6 = Data(flatten(cull_2))
num_7 = Number(num_6)
boundary_3 = BoundarySurfaces(Edges=polygon_2.Polygon)
extr_2 = Extrude(Base=boundary_3, Direction=Z)
voronoi = Voronoi(Points=data_6, Boundary=brec.Bounding, BruteForceOverride=False)
extr_3 = Extrude(Base=boundary, Direction=Z)
mp = MultiPipe(Curves=voronoi, NodeSize=Slider(3, range=0..10), EndOffset=1, StrutSize=1, Segment=0, KinkAngle=0.6, CubeFit=0)
live_cells = Mesh(extr_2)
meshgrid = Mesh(extr_3)
gradient_2 = Gradient(
    LowerLimit=0,
    UpperLimit=1,
    Parameter=branch,
    stops=[0: RGB(142, 156, 202), 0: RGB(115, 79, 171), 0.0659: RGB(218, 0, 249), 1: RGB(246, 177, 137), 1: RGB(255, 255, 255), 1: RGB(0, 0, 0), 1: RGB(192, 255, 255)])
vornoi_multipipe = Mesh(mp)
swatch_2 = ColourSwatch(SwatchColor=RGB(96, 209, 109))
mcol_3 = MeshColours(Mesh=meshgrid, Colours=ColourSwatch(SwatchColor=RGB(178, 178, 178)))  # -> flatten(Mesh)
mcol_4 = MeshColours(Mesh=live_cells, Colours=ColourSwatch(SwatchColor=RGB(96, 209, 109)))

# ---- group: RH_IN:Display Mode
number_slider = Slider(0, range=0..1)

# ----
mcol_5 = MeshColours(Mesh=vornoi_multipipe, Colours=gradient_2)
filter_2 = StreamFilter(Gate=number_slider, Stream0=[mcol_3, mcol_4], Stream1=mcol_5)
mjoin = MeshJoin(Meshes=filter_2)
rh_out_mesh = Mesh(mjoin)
