# Grasshopper definition concrete jungle.gh (Grasshopper 1.0.7)

# ---- group: RH_IN:Grid Size
rh_in = Slider(50, range=35..60)

# ----
rh_in_density = ValueList({"Sparse": 4, "Dense": 5}, selected="Sparse")
number_slider = Slider(5, range=0..10)
pt = ConstructPoint(XCoordinate=0, YCoordinate=0, ZCoordinate=0)
polygon = Polygon(Plane=pt, Radius=rh_in, Segments=rh_in_density, FilletRadius=0)  # -> Polygon, Length
rad = Radians(Degrees=Slider(45, range=0..100))
rotate = Rotate(Geometry=polygon.Polygon, Angle=rad, Plane=PlaneXY(0, 0, 0))  # -> Geometry, Transform
number_slider_2 = Slider(20, range=0..100)
boundary = BoundarySurfaces(Edges=rotate.Geometry)
divide = DivideDomain²(Domain=boundary, UCount=number_slider_2, VCount=number_slider_2)
subsrf = Isotrim(Surface=boundary, Domain=divide)  # -> graft(Surface)
number_slider_3 = Slider(3, range=0..10)

# ---- group: RH_IN:Unit Spacing
number_slider_4 = Slider(6, range=2..6)

# ----
item = ListItem(List=divide, Index=0, Wrap=True)
dedom2 = DeconstructDomain²(Domain=item)  # -> UComponent, VComponent
series = Series(Start=0, Step=number_slider_3, Count=Slider(9, range=0..100))
div = DivideDomain(Domain=dedom2.UComponent, Count=Slider(2, range=0..10))
Z = UnitZ(Factor=series)
division = Division(A=number_slider_3, B=number_slider_4)
move = Move(Geometry=subsrf, Motion=Z)  # -> Geometry, Transform
area = Area(Geometry=move.Geometry)  # -> Area, flatten(Centroid)
box = CenterBox(Base=area.Centroid, X=div, Y=div, Z=division)
Z_2 = UnitZ(Factor=number_slider_4)
move_2 = Move(Geometry=box, Motion=Z_2)  # -> Geometry, Transform
bbox = BoundingBox(Content=move_2.Geometry, Plane=PlaneXY(0, 0, 0), UnionBox=True)  # -> Box, Box_2
pop3d = Populate3D(Region=bbox.Box, Count=Slider(555, range=0..1000), Seed=1)
pdecon = Deconstruct(Point=pop3d)  # -> XComponent, YComponent, ZComponent
bnd = Bounds(Numbers=pdecon.ZComponent)
remap = RemapNumbers(Value=pdecon.ZComponent, Source=bnd, Target=Domain(0, 1))  # -> Mapped, Clipped
random = Random(Range=Domain(0, 1), Number=Slider(18, range=0..100), Seed=2)
larger = LargerThan(FirstNumber=remap.Mapped, SecondNumber=random)  # -> LargerThan, OrEqualTo
cull = CullPattern(List=pop3d, CullPattern=larger.LargerThan)
lng = ListLength(List=cull)
multiplication = Multiplication(A=lng, B=Slider(0.779, range=0..1))
dom = ConstructDomain(DomainStart=0, DomainEnd=Slider(6, range=0..10))
reduce = RandomReduce(List=cull, Reduction=multiplication, Seed=Slider(121, range=0..1000))
lng_2 = ListLength(List=reduce)
random_2 = Random(Range=dom, Number=lng_2, Seed=2)
project = Project(Geometry=reduce, Plane=PlaneXY(0, 0, 0))  # -> Geometry, Transform
multiplication_2 = Multiplication(A=random_2, B=Slider(0.1, range=0..1))
ln = Line(StartPoint=reduce, EndPoint=project.Geometry)
sph = Sphere(Base=reduce, Radius=random_2)
pull = PullPoint(Point=area.Centroid, Geometry=sph, ClosestOnly=True)  # -> ClosestPoint, Distance
larger_2 = LargerThan(FirstNumber=pull.Distance, SecondNumber=Slider(8, range=0..10))  # -> LargerThan, OrEqualTo
cull_2 = CullPattern(List=move_2.Geometry, CullPattern=larger_2.LargerThan)
rh_out_meshunits = Mesh(cull_2)
debrep = DeconstructBrep(Brep=cull_2)  # -> Faces, Edges, Vertices
item_2 = ListItem(List=debrep.Faces, Index=Slider(4, range=0..10), Wrap=True)
debrep_2 = DeconstructBrep(Brep=item_2)  # -> Faces, Edges, Vertices
project_2 = Project(Geometry=debrep_2.Vertices, Plane=PlaneXY(0, 0, 0))  # -> simplify(Geometry), Transform
ln_2 = Line(StartPoint=debrep_2.Vertices, EndPoint=project_2.Geometry)  # -> simplify(Line)
len = Length(Curve=ln_2)
neg = Negative(Value=len)
Z_3 = UnitZ(Factor=neg)
polygon_2 = Polygon(Plane=ln_2, Radius=Slider(0.3, range=0..1), Segments=Slider(4, range=0..10), FilletRadius=0)  # -> Polygon, Length
extr = Extrude(Base=polygon_2.Polygon, Direction=Z_3)
cap = CapHoles(Brep=extr)  # -> flatten(Brep)
rh_out_meshtree1 = Mesh(cap)
preview = CustomPreview(Geometry=[cull_2, extr], Material=ColourSwatch(SwatchColor=RGB(89, 89, 89)))
len_2 = Length(Curve=ln)
volume = Volume(Geometry=sph)  # -> Volume, Centroid
division_2 = Division(A=volume.Volume, B=len_2)
larger_3 = LargerThan(FirstNumber=division_2, SecondNumber=Slider(4, range=0..10))  # -> LargerThan, OrEqualTo
panel = Panel(sph)
pipe = Pipe(Curve=ln, Radius=multiplication_2, Caps=0)  # -> flatten(Pipe)
cull_3 = CullPattern(List=sph, CullPattern=larger_3.LargerThan)
cull_4 = CullPattern(List=pipe, CullPattern=larger_3.LargerThan)
panel_2 = Panel(pipe)
entwine = Entwine(Branch00=cull_3, Branch01=cull_4, FlattenInputs=True)

# ---- group: RH_IN:Reduce Trees
number_slider_5 = Slider(0, range=0..10)

# ----
reduce_2 = RandomReduce(List=entwine, Reduction=number_slider_5, Seed=1)  # -> simplify(List)
branch = TreeBranch(Tree=reduce_2, Path=Slider(1, range=0..1), MaintainPaths=True)
branch_2 = TreeBranch(Tree=reduce_2, Path=Slider(0, range=0..1), MaintainPaths=True)
mesh = MeshBrep(
    Brep=branch_2,
    Settings={GridMaxCount=0, GridMinCount=16, JaggedSeams=False, MaxEdgeLength=0, MinEdgeLength=0.0001, MinTolerance=0, Refine=True, RefineAngle=0, RelativeTolerance=0.65, SimplePlanes=True, Tolerance=0})
mesh_2 = MeshBrep(
    Brep=branch,
    Settings={GridMaxCount=0, GridMinCount=16, JaggedSeams=False, MaxEdgeLength=0, MinEdgeLength=0.0001, MinTolerance=0, Refine=True, RefineAngle=0, RelativeTolerance=0.65, SimplePlanes=True, Tolerance=0})
preview_2 = CustomPreview(Geometry=branch, Material=ColourSwatch(SwatchColor=RGB(115, 70, 70)))
preview_3 = CustomPreview(Geometry=branch_2, Material=ColourSwatch(SwatchColor=RGB(102, 255, 120)))

# ---- group: RH_OUT:MeshTree1
rh_out_meshtree2 = Mesh(mesh_2)

# ----
rh_out_meshtree1_2 = Mesh(mesh)
