# Grasshopper definition meditationtemple.gh (Grasshopper 1.0.7)
# plug-ins: Pufferfish, Heteroptera

# Spiral 1 with seperate loft
# Spiral 1 with seperate loft
# Spiral 1 with seperate loft
# How to convert the curves into sine curves?
# How to convert the curves into sine curves?
rotation_steps = Slider(6, range=0..10)
# Spiral 1 with seperate loft
total_floors = Slider(8, range=0..20)
# PIPING / 3D PRINTING
# Spiral 1 with seperate loft
rotation_steps_2 = Slider(10, range=0..10)
total_floors_2 = Slider(8, range=0..20)
pt = ConstructPoint(XCoordinate=0, YCoordinate=0, ZCoordinate=0)
number_slider = Slider(38, range=0..100)
# Outer SKIN
pt_2 = ConstructPoint(XCoordinate=0, YCoordinate=0, ZCoordinate=0)
series = Series(Start=0, Step=rotation_steps, Count=total_floors)
series_2 = Series(Start=0, Step=rotation_steps_2, Count=total_floors_2)
cir = Circle(Plane=pt, Radius=Slider(15, range=0..100))
cir_2 = Circle(Plane=pt_2, Radius=Slider(32, range=0..100))
Z = UnitZ(Factor=series)
# Inner
number_slider_2 = Slider(0.2, range=0..1)
Z_2 = UnitZ(Factor=series_2)
move = Move(Geometry=cir, Motion=Z)  # -> Geometry, Transform
move_2 = Move(Geometry=cir_2, Motion=Z_2)  # -> Geometry, Transform
dom = ConstructDomain(DomainStart=Slider(0.7, range=0..1), DomainEnd=1)
dom_2 = ConstructDomain(DomainStart=number_slider_2, DomainEnd=1)
range = Range(Domain=dom, Steps=expr("x-1", total_floors))
area = Area(Geometry=move.Geometry)  # -> Area, Centroid
range_2 = Range(Domain=dom_2, Steps=expr("x-1", total_floors_2))
area_2 = Area(Geometry=move_2.Geometry)  # -> Area, Centroid
graph = GraphMapper(range, x0=0, x1=1, y0=0, y1=1, Ox=0, Oy=0.1428571343, Px=0.5, Py=0.2585033774, container_name="Parabola")
graph_mapper = GraphMapper(
    range,
    x0=0,
    x1=1,
    y0=0,
    y1=1,
    container_name="Bezier",
    cpx=[0, 1, 0.630682528, 1],
    cpy=[0, 0, 0.9807034135, 0.9183669686])
graph_2 = GraphMapper(range_2, x0=0, x1=1, y0=0, y1=1, Ox=0, Oy=0, Px=1, Py=0.7003273368, container_name="Parabola")
rev = ReverseList(List=graph_mapper)
rev_2 = ReverseList(List=graph_2)
division = Division(A=Slider(20, range=0..100), B="12")
rh_in_rotation1 = Slider(2.5, range=1.5..3.5)
scale = Scale(Geometry=move.Geometry, Center=area.Centroid, Factor=rev)  # -> Geometry, Transform
scale_2 = Scale(Geometry=move_2.Geometry, Center=area_2.Centroid, Factor=rev_2)  # -> Geometry, Transform
arms = Slider(12, range=5..15)
number_slider_3 = Slider(30, range=0..100)
rh_in_rotation2 = Slider(18, range=5..20)
multiplication = Multiplication(A=arms, B=rh_in_rotation1)
number_slider_4 = Slider(100, range=0..100)
divide = DivideCurve(Curve=scale.Geometry, Count=multiplication, Kinks=False)  # -> Points, Tangents, Parameters
viewer = ParamViewer(divide.Points)
divide_2 = DivideCurve(Curve=scale_2.Geometry, Count=arms, Kinks=False)  # -> Points, Tangents, Parameters
viewer_2 = ParamViewer(divide_2.Points)
# How to convert the curves into sine curves?
data = Data(total_floors_2)
division_2 = Division(A=Slider(16, range=0..100), B=Slider(11, range=0..100))
series_3 = Series(Start=0, Step=rh_in_rotation2, Count=data)
number_slider_5 = Slider(100, range=0..100)
graft = GraftTree(Tree=series_3, IncludeEmptyLists=True, IncludeNullItems=True)
data_2 = Data(total_floors)
rotate = Rotate(Geometry=divide_2.Points, Angle=degrees(graft), Plane=PlaneXY(0, 0, 0))  # -> Geometry, Transform
multiplication_2 = Multiplication(A=rh_in_rotation2, B=division_2)
series_4 = Series(Start=0, Step=multiplication_2, Count=data_2)
graft_2 = GraftTree(Tree=series_4, IncludeEmptyLists=True, IncludeNullItems=True)
rotate_2 = Rotate(Geometry=divide.Points, Angle=degrees(graft_2), Plane=PlaneXY(0, 0, 0))  # -> Geometry, Transform
flip = FlipMatrix(Data=rotate_2.Geometry)
flip_2 = FlipMatrix(Data=rotate.Geometry)
intcrv = Interpolate(Vertices=flip, Degree=3, Periodic=False, KnotStyle=1)  # -> flatten(Curve), Length, Domain
intcrv_2 = Interpolate(Vertices=flip_2, Degree=3, Periodic=False, KnotStyle=1)  # -> flatten(Curve), Length, Domain
mirror = Mirror(Geometry=intcrv.Curve, Plane=PlaneYZ(0, 0, 0))  # -> Geometry, Transform
mirror_2 = Mirror(Geometry=intcrv_2.Curve, Plane=PlaneYZ(0, 0, 0))  # -> Geometry, Transform
merge = Merge(Data1=intcrv.Curve, Data2=mirror.Geometry)
merge_2 = Merge(Data1=intcrv_2.Curve, Data2=mirror_2.Geometry)
number_slider_6 = Slider(468, range=0..1000)
number_slider_7 = Slider(468, range=0..1000)
number_slider_8 = Slider(468, range=0..1000)
number_slider_9 = Slider(100, range=0..100)
divide_3 = DivideCurve(Curve=merge, Count=Slider(100, range=0..100), Kinks=False)  # -> Points, Tangents, Parameters
divide_4 = DivideCurve(Curve=merge_2, Count=Slider(468, range=0..1000), Kinks=False)  # -> Points, Tangents, Parameters
flip_3 = FlipMatrix(Data=divide_3.Points)
flip_4 = FlipMatrix(Data=divide_4.Points)
number_slider_10 = Slider(20, range=0..100)
number_slider_11 = Slider(0.03, range=0..0.1)
number_slider_12 = Slider(0.04, range=0..0.1)
item = ListItem(List=flip_3, Index=0, Wrap=True)  # -> flatten(Item)
number_slider_13 = Slider(0.1, range=0..0.1)
item_2 = ListItem(List=flip_4, Index=0, Wrap=True)  # -> flatten(Item)
lng = ListLength(List=item)  # -> flatten(Length)
lng_2 = ListLength(List=item_2)  # -> flatten(Length)
divide_5 = DivideCurve(Curve=scale_2.Geometry, Count=number_slider_10, Kinks=False)  # -> Points, Tangents, Parameters
division_3 = Division(A=number_slider_10, B="2")
series_5 = Series(Start=0, Step=1, Count=expr("x+1", division_3))
series_6 = Series(Start=number_slider_13, Step=number_slider_13, Count=lng)
number_slider_14 = Slider(0.17, range=0..1)
series_7 = Series(Start=number_slider_11, Step=number_slider_11, Count=lng_2)
item_3 = ListItem(List=divide_5.Points, Index=series_5, Wrap=True)
rev_3 = ReverseList(List=series_6)  # -> graft(List)
rev_4 = ReverseList(List=series_7)  # -> graft(List)
intcrv_3 = Interpolate(Vertices=item_3, Degree=3, Periodic=False, KnotStyle=1)  # -> Curve, Length, Domain
cir_3 = Circle(Plane=flip_4, Radius=rev_4)
cir_4 = Circle(Plane=flip_3, Radius=rev_3)
end = EndPoints(Curve=intcrv_3.Curve)  # -> Start, End
ln = Line(StartPoint=end.Start, EndPoint=end.End)  # -> flatten(Line)
scale_3 = Scale(Geometry=cir_4, Center=cir_4, Factor=Slider(0.15, range=0..1))  # -> Geometry, Transform
scale_4 = Scale(Geometry=cir_3, Center=cir_3, Factor=Slider(0.15, range=0..1))  # -> Geometry, Transform
loft = Loft(Curves=ln, Options={Adjust=False, Closed=False, LoftEnds=0, LoftSimp=0, LoftType=0, Rebuild=10, Refit=0.01})
area_3 = Area(Geometry=scale_3.Geometry)  # -> Area, Centroid
area_4 = Area(Geometry=scale_4.Geometry)  # -> Area, Centroid
number_slider_15 = Slider(9, range=0..100)
number_slider_16 = Slider(9, range=0..100)
rotate_3 = Rotate(Geometry=loft, Angle=degrees(Slider(90, range=0..100)), Plane=PlaneXY(0, 0, 0))  # -> Geometry, Transform
scale_5 = Scale(Geometry=scale_3.Geometry, Center=area_3.Centroid, Factor=Slider(0.86, range=0..1))  # -> Geometry, Transform
scale_6 = Scale(Geometry=scale_4.Geometry, Center=area_4.Centroid, Factor=Slider(0.86, range=0..1))  # -> Geometry, Transform
paramsubdivsrf = ParameterSubdivideSurface(Surface=rotate_3.Geometry, ParametersU=[0, 0.25, 0.5, 0.75, 1], ParametersV=[0, 0.25, 0.5, 0.75, 1])
divide_6 = DivideCurve(Curve=scale_3.Geometry, Count=number_slider_15, Kinks=False)  # -> Points, Tangents, Parameters
divide_7 = DivideCurve(Curve=scale_5.Geometry, Count=number_slider_15, Kinks=False)  # -> Points, Tangents, Parameters
divide_8 = DivideCurve(Curve=scale_4.Geometry, Count=number_slider_16, Kinks=False)  # -> Points, Tangents, Parameters
divide_9 = DivideCurve(Curve=scale_6.Geometry, Count=number_slider_16, Kinks=False)  # -> Points, Tangents, Parameters
dispatch = Dispatch(List=divide_6.Points, DispatchPattern=[True, False])  # -> ListA, ListB
dispatch_2 = Dispatch(List=divide_7.Points, DispatchPattern=[True, False])  # -> ListA, ListB
dispatch_3 = Dispatch(List=divide_8.Points, DispatchPattern=[True, False])  # -> ListA, ListB
dispatch_4 = Dispatch(List=divide_9.Points, DispatchPattern=[True, False])  # -> ListA, ListB
weave = Weave(Pattern=[0, 1], Stream0=dispatch.ListA, Stream1=dispatch_2.ListB, NullGaps=False)
weave_2 = Weave(Pattern=[0, 1], Stream0=dispatch_3.ListA, Stream1=dispatch_4.ListB, NullGaps=False)
nurbs = NurbsCurve(Vertices=weave, Degree=Slider(2, range=0..10), Periodic=True)  # -> simplify(Curve), Length, Domain
nurbs_2 = NurbsCurve(Vertices=weave_2, Degree=Slider(2, range=0..10), Periodic=True)  # -> simplify(Curve), Length, Domain
path_mapper = PathMapper(nurbs.Curve, source="{A;B}", target="{A}")
path_mapper_2 = PathMapper(nurbs_2.Curve, source="{A;B}", target="{A}")
flip_5 = FlipMatrix(Data=path_mapper)
# Spiral 1 with seperate loft
flip_6 = FlipMatrix(Data=path_mapper_2)
loft_2 = Loft(Curves=flip_5, Options={Adjust=False, Closed=False, LoftEnds=0, LoftSimp=0, LoftType=0, Rebuild=10, Refit=0.01})
scale_7 = Scale(Geometry=loft_2, Center=Point(0, 0, 0), Factor=Slider(1.05, range=0..10))  # -> Geometry, Transform
loft_3 = Loft(Curves=flip_6, Options={Adjust=False, Closed=False, LoftEnds=0, LoftSimp=0, LoftType=0, Rebuild=10, Refit=0.01})
mesh = MeshBrep(
    Brep=loft_3,
    Settings={GridMaxCount=0, GridMinCount=16, JaggedSeams=False, MaxEdgeLength=0, MinEdgeLength=0.0001, MinTolerance=0, Refine=True, RefineAngle=0, RelativeTolerance=0.65, SimplePlanes=True, Tolerance=0})
swatch = ColourSwatch(SwatchColor=RGB(204, 204, 204))  # disabled
rotate_4 = Rotate(Geometry=loft_2, Angle=degrees(Slider(90, range=0..100)), Plane=PlaneXY(0, 0, 0))  # -> Geometry, Transform
mjoin = MeshJoin(Meshes=flatten(mesh))
preview = CustomPreview(Geometry=rotate_4.Geometry, Material=swatch)  # disabled
rh_out_mesh1 = Mesh(mjoin)
mesh_2 = MeshBrep(
    Brep=rotate_4.Geometry,
    Settings={GridMaxCount=0, GridMinCount=16, JaggedSeams=False, MaxEdgeLength=0, MinEdgeLength=0.0001, MinTolerance=0, Refine=True, RefineAngle=0, RelativeTolerance=0.65, SimplePlanes=True, Tolerance=0})
mjoin_2 = MeshJoin(Meshes=flatten(mesh_2))
rh_out_mesh2 = Mesh(mjoin_2)
data_3 = Data(cir_2)
crv = Curve(data_3)
number_of_sun_vectors = Panel("50")
angle_of_sun_rays = Panel("-1.5")
brec = BoundingRectangle(Geometry=crv, Plane=PlaneXY(0, 0, 0), Axis=0, Slide=0, Union=True)  # -> Bounding, DimensionX, DimensionY
center = Center(Geometrical=brec.Bounding)  # -> Center, Dimension
Y = UnitY(Factor=1)
X = UnitX(Factor=1)
scale_8 = Scale(Geometry=brec.Bounding, Center=center.Center, Factor=Slider(3, range=0..10))  # -> Geometry, Transform
vrot = Rotate(Vector=X, Axis=Y, Angle=degrees(angle_of_sun_rays))
cap = CapHoles()
boundary = BoundarySurfaces(Edges=scale_8.Geometry)
line = LineSDL(Start=center.Center, Direction=vrot, Length=Slider(68, range=0..1000))
range_3 = Range(Domain="0 to 2", Steps=number_of_sun_vectors)
pi = Pi(Factor=range_3)
xz = XZPlane(Origin=Point(0, 0, 0))
rotate_5 = Rotate(Geometry=line, Angle=pi, Plane=center.Center)  # -> Geometry, Transform
rotate_6 = Rotate(Geometry=rotate_5.Geometry, Angle=degrees(Slider(3.7, range=0..10)), Plane=xz)  # -> Geometry, Transform
lng_3 = ListLength(List=rotate_6.Geometry)
division_4 = Division(A=lng_3, B="2")
ladybug = Ladybug_Ladybug()  # -> Vviiiiiiiiiizzz; plug-in component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
series_8 = Series(Start=Slider(38, range=0..100), Step=1, Count=expr("x+1", division_4))
item_4 = ListItem(List=rotate_6.Geometry, Index=series_8, Wrap=True)
item_5 = ListItem(List=item_4, Index=Slider(13, range=0..26), Wrap=True)
rh_in_analysis_on = BooleanToggle(False)
end_2 = EndPoints(Curve=item_4)  # -> Start, End
vec2pt = Vector2Pt(PointA=end_2.End, PointB=end_2.Start, Unitize=False)  # -> Vector, Length
filter = StreamFilter(Gate=rh_in_analysis_on, Stream1=rotate_3.Geometry)
sph = Sphere(Base=end_2.End, Radius=Slider(6, range=0..100))
rh_in_sunlight_hours = BooleanToggle(False)
vdis = VectorDisplay(Anchor=end_2.End, Vector=vec2pt.Vector)  # disabled
preview_2 = CustomPreview(Geometry=sph, Material=ColourSwatch(SwatchColor=RGB(255, 201, 92)))  # disabled
number_slider_17 = Slider(4, range=0..10)
sunlighthoursanalysis = Ladybug_SunlightHoursAnalysis(
    geometry=flatten(filter),
    context=flatten([loft_3, loft_2]),
    gridSize="2",
    disFromBase="0.01",
    sunVectors=flatten(vec2pt.Vector),
    timeStep=1,
    runIt=rh_in_sunlight_hours)  # -> readMe, contextMesh, analysisMesh, testPts, testVec, port, sunlightHoursResult, sunlightHoursMesh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; plug-in component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
series_9 = Series(Start=0, Step=1, Count=Slider(4, range=0..10))
series_10 = Series(Start=number_slider_17, Step=1, Count=number_slider_17)
series_11 = Series(Start="8", Step=1, Count=Slider(8, range=0..10))
item_6 = ListItem(List=paramsubdivsrf, Index=series_9, Wrap=True)
item_7 = ListItem(List=paramsubdivsrf, Index=series_10, Wrap=True)
item_8 = ListItem(List=paramsubdivsrf, Index=series_11, Wrap=True)  # -> flatten(Item)
ma = MassAddition(Input=flatten(sunlighthoursanalysis.sunlightHoursResult))  # -> Result, PartialResults
panel = Panel(ma.Result)
mesh_3 = Mesh(sunlighthoursanalysis.sunlightHoursMesh)
mesh_4 = Mesh(sunlighthoursanalysis.sunlightHoursLegend)
X_2 = UnitX(Factor=Slider(60, range=0..100))
one_over_x = OneOverX(Value=panel)
move_3 = Move(Geometry=mesh_3, Motion=X_2)  # -> Geometry, Transform
area_5 = Area(Geometry=move_3.Geometry)  # -> Area, Centroid
wlc_maximize_light_fc3 = Data(one_over_x)
rotate_7 = Rotate(Geometry=move_3.Geometry, Angle=1.570796327, Plane=area_5.Centroid)  # -> Geometry, Transform
rh_out_mesh3 = Data(rotate_7.Geometry)
merge_3 = Merge(Data1=loft_3, Data2=loft_2, Data4=item_7)
